# Grasshopper definition tester.ghx (Grasshopper 1.0.7)

ghpython_script = GhPythonScript(index=Slider(0, range=0..100))  # -> box, geo; inputs index: Int32
# ---------- ghpython_script: Python ----------
from writehops import HOPSWriter, FrenchRidgeProcess, DoubleCutProcess
from parse_btlx import BTLXParser
from compas_rhino import unload_modules
import math
from compas_rhino.conversions import frame_to_rhino, point_to_rhino

from compas.geometry import Transformation, Frame, Point, Plane, Rotation, angle_vectors_signed, Vector, angle_vectors

from compas.rpc import Proxy
from compas.geometry import Box

import Rhino.Geometry as rg
import os

from copy import deepcopy

unload_modules("writehops")
unload_modules("parse_btlx")

file_path = os.path.join(os.path.dirname(ghenv.Component.OnPingDocument().FilePath), "240514_Module81.btlx")
parser = BTLXParser(file_path)
remachining_dict = parser.get_remachining_dict()

keys = [key for key, value in remachining_dict.items()]

index = keys[index]
#print(remachining_dict)
length = remachining_dict[str(index)]["length"]
hopper = HOPSWriter(length)
processes = []
geo = []
box = Box.from_corner_corner_height([0,0,0], [length, 60,0], 60)
for machining in remachining_dict[str(index)]["machinings"]:
    if machining["Name"] == "FrenchRidgeLapJoint":
        process = FrenchRidgeProcess(hopper, machining["facefront"])
    elif machining["Name"] == "T-Butt Joint":
        process = DoubleCutProcess(hopper, machining)
    processes.append(process)
    geo.extend([frame_to_rhino(process.frame1), frame_to_rhino(process.frame2)])
hopper.generate_hops(processes)
    #create folder with btlx name
#    filename = os.path.join(os.path.dirname(__file__),"hops", "%s_.hop" % str(index))
# ---------- end ghpython_script ----------
plane = Plane(ghpython_script.geo)
draw = Draw(cg=ghpython_script.box)  # -> rg
#   port cg: The COMPAS geometry or datastructure to be drawn.
#   port rg: The Rhino geometry object.
# ---------- draw: Python ----------
"""
Draws COMPAS geometry in Grasshopper.
"""
from ghpythonlib.componentbase import executingcomponent as component

from compas.scene import SceneObject


class CompasToRhinoGeometry(component):
    def RunScript(self, cg):
        if not cg:
            return None

        return SceneObject(cg).draw()
# ---------- end draw ----------
